# Grasshopper definition 布局v1.gh (Grasshopper 1.0.7)

建筑密度 = CSharpScript(min=Slider(0.15, range=0..1), max=Slider(0.25, range=0..1))  # -> density; inputs min: Double, max: Double
# ---------- 建筑密度: C# ----------
    if(max >= min){
      List<double> temp = new List<double>();
      temp.Add(min);
      temp.Add(max);
      density = temp;
    }
# ---------- end 建筑密度 ----------
容积率 = CSharpScript(min=Slider(2, range=0..6), max=Slider(3.5, range=0..6))  # -> plotRatio; inputs min: Double, max: Double
# ---------- 容积率: C# ----------
    if(max >= min){
      List<double> temp = new List<double>();
      temp.Add(min);
      temp.Add(max);
      plotRatio = temp;
    }
# ---------- end 容积率 ----------
层数 = CSharpScript(min=Slider(5, range=0..50), initial=Slider(7, range=0..50), max=Slider(9, range=0..100))  # -> floor; inputs min: Int32, initial: Int32, max: Int32
# ---------- 层数: C# ----------
    if(max >= initial && initial >= min){
      List<int> temp = new List<int>();
      temp.Add(initial);
      temp.Add(min);
      temp.Add(max);
      floor = temp;
    }
# ---------- end 层数 ----------
边界范围 = Curve(<curve referenced from the Rhino model>)
缩放因子 = Slider(0.95, range=0..1)
最小建筑面积 = Number(1600)
楼高 = Slider(3, range=0..5)
容错阈值 = Slider(0, range=0..1)

crv = Curve(<curve referenced from the Rhino model>)

# ----
# 建筑类型
pt = Point([Point(0, 0, 0), Point(0, 1, 0), Point(2, 1, 0), Point(2, 0, 0), Point(0, 0, 0)])
pt_2 = Point([Point(0, 0, 0), Point(0, 3, 0), Point(1, 3, 0), Point(1, 1, 0), Point(2, 1, 0), Point(2, 0, 0), Point(0, 0, 0)])
pt_3 = Point([Point(0, 0, 0), Point(0, 2, 0), Point(1, 2, 0), Point(1, 1, 0), Point(3, 1, 0), Point(3, 2, 0), Point(4, 2, 0), Point(4, 0, 0), Point(0, 0, 0)])
pt_4 = Point([Point(0, 0, 0), Point(0, 1, 0), Point(1, 1, 0), Point(1, 3, 0), Point(0, 3, 0), Point(0, 4, 0), Point(3, 4, 0), Point(3, 3, 0), Point(2, 3, 0), Point(2, 1, 0), Point(3, 1, 0), Point(3, 0, 0), Point(0, 0, 0)])
u型 = PolyLine(Vertices=pt_3, Closed=False)
工型 = PolyLine(Vertices=pt_4, Closed=False)
矩形 = PolyLine(Vertices=pt, Closed=False)
l型 = PolyLine(Vertices=pt_2, Closed=False)

crv_2 = Curve(<curve referenced from the Rhino model>)
crv_3 = Curve(<curve referenced from the Rhino model>)
crv_4 = Curve(<curve referenced from the Rhino model>)
crv_5 = Curve(<curve referenced from the Rhino model>)
crv_6 = Curve(<curve referenced from the Rhino model>)
crv_7 = Curve([<curve referenced from the Rhino model> x3])
crv_8 = Curve(<curve referenced from the Rhino model>)
crv_9 = Curve(<curve referenced from the Rhino model>)
crv_10 = Curve(<curve referenced from the Rhino model>)
crv_11 = Curve(<curve referenced from the Rhino model>)
crv_12 = Curve(<curve referenced from the Rhino model>)
pcen = PolygonCenter(Polyline=矩形)  # -> CenterV, CenterE, CenterA

# ----
# Run
boolean_toggle = BooleanToggle(False)
c_script = CSharpScript(ACTIVE=boolean_toggle)  # -> X; inputs ACTIVE: Boolean
# ---------- c_script: C# ----------
    _active = ACTIVE;
    string message = "";
    GrasshopperDocument.ScheduleSolution(5, Callback);
    if(ACTIVE){
      message = "\r\n程序处于运行状态，请稍等。提示：文件保存前，请勿必双击按钮恢复为停止状态！";
    }
    else{
      message = "\r\n程序处于停止状态。提示：可修改参数后，双击按钮运行程序！";
    }
    X = message;
# ---------- c_script: C# additional code ----------
  private bool _active;
  private void Callback(GH_Document doc)
  {
    foreach(var obj in GrasshopperDocument.ActiveObjects())
      if("buildingGenerator" == obj.NickName)
      {
        obj.Locked = !_active;
        obj.ExpireSolution(false);
      }
  }
# ---------- end c_script ----------
panel = Panel(c_script)

crv_13 = Curve(<curve referenced from the Rhino model>)
scale = Scale(Geometry=矩形, Center=pcen.CenterA, Factor=30)  # -> Geometry, Transform
crv_14 = Curve(<curve referenced from the Rhino model>)
crv_15 = Curve(<curve referenced from the Rhino model>)
area = Area(Geometry=scale.Geometry)  # -> Area, Centroid
brep = Brep([crv_2, crv_5, crv_7, crv_10])
brep_2 = Brep([crv_3, crv_6, crv_11, crv, crv_8, crv_9])

# ----
# 建筑类型
pt_5 = Point([Point(0, 0, 0), Point(0, 13.75, 0), Point(29.2, 13.75, 0), Point(29.2, 0, 0), Point(0, 0, 0)])
pt_6 = Point([Point(5.4, 0, 0), Point(5.4, 17, 0), Point(0, 17, 0), Point(0, 27.2, 0), Point(28.6, 27.2, 0), Point(28.6, 17, 0), Point(23.2, 17, 0), Point(23.2, 0, 0), Point(5.4, 0, 0)])
pt_7 = Point([Point(0, 0, 0), Point(0, 46.8, 0), Point(45.97, 46.8, 0), Point(45.97, 26.8, 0), Point(21.8, 26.8, 0), Point(21.8, 0, 0), Point(0, 0, 0)])
pt_8 = Point([Point(0, 0, 0), Point(0, 70, 0), Point(80, 70, 0), Point(80, 50, 0), Point(20, 50, 0), Point(20, 20, 0), Point(80, 20, 0), Point(80, 0, 0), Point(0, 0, 0)])
pt_9 = Point([Point(1.6, 0, 0), Point(1.6, 10, 0), Point(8.45, 10, 0), Point(8.45, 13.5, 0), Point(0, 13.5, 0), Point(0, 23.5, 0), Point(26.1, 23.5, 0), Point(26.1, 13.5, 0), Point(17.65, 13.5, 0), Point(17.65, 10, 0), Point(24.5, 10, 0), Point(24.5, 0, 0), Point(1.6, 0, 0)])
t形 = PolyLine(Vertices=pt_6, Closed=False)
矩形_2 = PolyLine(Vertices=pt_5, Closed=False)
l型_2 = PolyLine(Vertices=pt_7, Closed=False)
u型_2 = PolyLine(Vertices=pt_8, Closed=False)
工型_2 = PolyLine(Vertices=pt_9, Closed=False)

brep_3 = Brep([crv_12, crv_4])
brep_4 = Brep(crv_15)
brep_5 = Brep(crv_14)
buildinggenerator00 = CSharpScript(
    boundary=边界范围,
    shape_type=scale.Geometry,
    floor_height=楼高,
    density=建筑密度,
    plotRatio=容积率,
    floor=层数,
    threashold=容错阈值,
    scale_factor=缩放因子,
    area_limit=最小建筑面积)  # -> out, position, buildings, offShape, w; inputs boundary: Curve, shape_type: Curve, floor_height: Double, density: list of Double, plotRatio: list of Double, floor: list of Int32, threashold: Double, scale_factor: Double, area_limit: Double, active: Boolean
# ---------- buildinggenerator00: C# ----------
    //======初始化======
    com_void = new Common_void();
    string warning = "";

    double density_min = density_[0];
    double density_max = density_[1];
    double plotRatio_min = plotRatio_[0];
    double plotRatio_max = plotRatio_[1];
    int floor_num = floor_[0];
    int floor_min = floor_[1];
    int floor_max = floor_[2];
    //计算场地面积
    double boundaryArea = AreaMassProperties.Compute(boundary).Area;
    double shape_area = AreaMassProperties.Compute(shape_type).Area;

    //建筑密度计算智能体个数范围
    double area_scale = shape_area;
    double area_min = shape_area;
    int scale_dnum = 0;
    if(scale_factor != 1){
      while(area_scale >= area_limit){
        area_scale = area_scale * scale_factor * scale_factor;
        scale_dnum += 1;
      }
      area_min = area_scale * 1 / (scale_factor * scale_factor);
      scale_dnum -= 1;
    }

    int build_num_dmin = (int) Math.Ceiling(boundaryArea * density_min / shape_area);
    int build_num_dmax = (int) (boundaryArea * density_max / (area_min));
    //容积率计算智能体个数范围
    int build_num_pmin = (int) Math.Ceiling(plotRatio_min * boundaryArea / (shape_area * floor_max));
    int build_num_pmax = (int) (plotRatio_max * boundaryArea / (area_min * floor_min));
    //综合计算智能体个数范围
    int build_num_min,build_num_max = 0;
    if(build_num_dmin > build_num_pmin){
      build_num_min = build_num_dmin;}
    else{
      build_num_min = build_num_pmin;
    }
    if(build_num_dmax > build_num_pmax){
      build_num_max = build_num_pmax;}
    else{
      build_num_max = build_num_dmax;
    }

    //生成随机智能体个数
    Random rd = new Random();
    int build_num = rd.Next(build_num_min, build_num_max);
    //build_num = build_num;

    //生成相应个数的随机点与基于模板的建筑图形
    List<Point3d> randomPoints = com_void.GetRandomPoints(build_num, boundary);
    List< Curve> shape_types = new List<Curve>();
    shape_types = com_void.RepeatCurve(build_num, shape_type);
    //创建智能体
    bs = new List<Building>();
    for(int i = 0; i < build_num; i++){
      Building b = new Building(boundary, randomPoints[i], shape_types[i], floor_height, floor_num, scale_dnum);
      bs.Add(b);
    }

    footPrint = new List<Curve>();
    offSet = new List<Curve>();

    for(int i = 0; i < bs.Count; i++){
      footPrint.Add(bs[i].shape);
      offSet.Add(bs[i].offShape);
    }

    buildings = footPrint;
    offShape = offSet;

    List<double> tt = new List<double>();
    tt.Add(build_num_min);
    tt.Add(build_num_max);
    w = tt;
# ---------- buildinggenerator00: C# additional code ----------
  //全局变量
  List<Building> bs;
  Common_void com_void;
  List<Point3d> pos_list;
  List<Curve> footPrint;
  List<Curve> offSet;


  //以下为构建建筑单体智能体代码
  public class Building{
    public Curve boundary;
    public Point3d pos;
    public Curve shape;
    public double floor_height;
    public int floor_num;
    public int scale_dnum;

    public Point3d siteCenter;
    public Curve offShape;
    public Vector3d move;

    public double overlapArea;
    public bool alimit;
    public Random rand;

    public Building(Curve boundary_, Point3d pos_, Curve shape_, double floor_height_, int floor_num_, int scale_dnum_){

      pos = new Point3d();
      floor_height = new double();
      floor_num = new int();
      scale_dnum = new int();
      boundary = boundary_;
      pos = pos_;
      shape = shape_;
      floor_height = floor_height_;
      floor_num = floor_num_;
      scale_dnum = scale_dnum_;

      siteCenter = GetCenter(boundary);
      Point3d center = AreaMassProperties.Compute(shape).Centroid;
      shape.Translate(new Vector3d(pos.X - center.X, pos.Y - center.Y, 0));
      offShape = CreateBuffer(shape, floor_height * floor_num);

      overlapArea = 0;
      if(scale_dnum > 0){
        alimit = false;
      }
      else{alimit = true;}
      rand = new Random();

    }

    //计算图形几何中心
    private Point3d GetCenter(Curve c){
      Point3d center = AreaMassProperties.Compute(c).Centroid;
      return center;
    }

    //清空各智能体的存储数据——>不符合要求的面积总和
    public void ClearOverlapArea(){
      overlapArea = 0;
    }

    //计算各智能体楼层数&&创建缓冲
    public void CalculateHeight(){
      offShape = CreateBuffer(shape, floor_height * floor_num);
    }
    //创建缓冲
    public Curve CreateBuffer(Curve x, double y)
    {

      List<Point3d> points_o = new List<Point3d>();
      List<Point3d> points_c = new List<Point3d>();
      int points_num = x.ToNurbsCurve().Points.Count;
      for (int i = 0;i < points_num;i++)
      {
        Point3d temp = new Point3d();
        x.ToNurbsCurve().Points.GetPoint(i, out temp);
        points_o.Add(temp);
        points_c.Add(temp);
      }
      //计算东南西北侧方向上的缓冲距离
      double distance_N,distance_E,distance_S,distance_W;
      if(0.3 * 30 + y - 30 * 0.1 < 6)
      {
        distance_E = distance_W = 6;
      }
      else
      {
        distance_E = distance_W = 0.3 * 30 + y - 30 * 0.1;
      }
      /*
      if(0.8 * 30 + y - 30 * 0.5 < 8)
      {
        distance_S = 8;
      }
      else
      {
        distance_S = 0.8 * 30 + y - 30 * 0.5;
      }
      */
      distance_S = 0;
      double sinHs = Math.Sin(Math.PI / 180 * 23) * Math.Sin(Math.PI / 180 * -23.5) + Math.Cos(Math.PI / 180 * 23) * Math.Cos(Math.PI / 180 * -23.5) * Math.Cos(0);
      double L = Math.Sqrt((y / sinHs) * (y / sinHs) - y * y);
      distance_N = L;
      //找出最北面的边的长度
      double distance_N_len = 0;
      for (int i = 0;i < points_num - 1;i++){
        //南北侧
        if(Math.Abs(points_o[i + 1].X - points_o[i].X) > Math.Abs(points_o[i + 1].Y - points_o[i].Y))
        {
          //北侧
          if((points_o[i + 1].X - points_o[i].X) > 0)
          {
            if(points_o[i + 1].X - points_o[i].X > distance_N_len){
              distance_N_len = points_o[i + 1].X - points_o[i].X;
            }
          }
        }
      }
      //图形均基于顺时针构建，因而可根据两点所形成的矢量方向，判断需要构建哪一方向的缓冲，最后用两点位置的移动进行缓冲的构建
      for (int i = 0;i < points_num - 1;i++){
        Point3d temp = new Point3d();
        //南北侧
        if(Math.Abs(points_o[i + 1].X - points_o[i].X) > Math.Abs(points_o[i + 1].Y - points_o[i].Y))
        {
          //北侧
          if((points_o[i + 1].X - points_o[i].X) > 0)
          {
            if(points_o[i + 1].X - points_o[i].X == distance_N_len){
              distance_N = L;
            }
            else{
              distance_N = 0;
            }
            temp = new Point3d(points_c[i].X, points_c[i].Y + distance_N, points_c[i].Z);
            points_c.RemoveAt(i);
            points_c.Insert(i, temp);
            temp = new Point3d(points_c[i + 1].X, points_c[i + 1].Y + distance_N, points_c[i + 1].Z);
            points_c.RemoveAt(i + 1);
            points_c.Insert(i + 1, temp);
          }
            //南侧
          else
          {
            temp = new Point3d(points_c[i].X, points_c[i].Y - distance_S, points_c[i].Z);
            points_c.RemoveAt(i);
            points_c.Insert(i, temp);
            temp = new Point3d(points_c[i + 1].X, points_c[i + 1].Y - distance_S, points_c[i + 1].Z);
            points_c.RemoveAt(i + 1);
            points_c.Insert(i + 1, temp);
          }
        }
          //东西侧
        else
        {
          if((points_o[i + 1].Y - points_o[i].Y) < 0)
          {
            //东侧
            temp = new Point3d(points_c[i].X + distance_E, points_c[i].Y, points_c[i].Z);
            points_c.RemoveAt(i);
            points_c.Insert(i, temp);
            temp = new Point3d(points_c[i + 1].X + distance_E, points_c[i + 1].Y, points_c[i + 1].Z);
            points_c.RemoveAt(i + 1);
            points_c.Insert(i + 1, temp);
          }
          else
          {
            //西侧
            temp = new Point3d(points_c[i].X - distance_W, points_c[i].Y, points_c[i].Z);
            points_c.RemoveAt(i);
            points_c.Insert(i, temp);
            temp = new Point3d(points_c[i + 1].X - distance_W, points_c[i + 1].Y, points_c[i + 1].Z);
            points_c.RemoveAt(i + 1);
            points_c.Insert(i + 1, temp);
          }
        }
      }
      //计算一个新的重合点，因为建筑轮廓上第一个点与最后一个点重合，构建缓冲后不重合
      double temp_x,temp_y;
      if(points_o[0].X == points_c[0].X)
      {
        temp_x = points_c[points_num - 1].X;
        temp_y = points_c[0].Y;
      }
      else
      {
        temp_x = points_c[0].X;
        temp_y = points_c[points_num - 1].Y;
      }
      Point3d point_orignal = new Point3d(temp_x, temp_y, points_c[0].Z);
      //重合点替换第一点
      points_c.RemoveAt(0);
      points_c.Insert(0, point_orignal);
      //重合点替换最后一点
      points_c.RemoveAt(points_num - 1);
      points_c.Insert(points_num - 1, point_orignal);
      Polyline buffer = new Polyline(points_c);
      return buffer.ToNurbsCurve();
    }

    //避免中心点重叠
    public void Overlap(List<Building> buildings){
      Vector3d randMove = new Vector3d(0, 0, 0);
      for(int i = 0; i < buildings.Count; i++){
        Building b = buildings[i];
        if(b != this && pos == b.pos){
          double randDir = Math.PI * rand.NextDouble();
          double bArea = AreaMassProperties.Compute(b.offShape).Area; //面积越大移动越远
          randMove = new Vector3d(Math.Cos(randDir) * bArea * 0.005, Math.Sin(randDir) * bArea * 0.005, 0);
          break;
        }
      }
      pos = Point3d.Add(pos, randMove);
      shape.Translate(randMove);
      offShape.Translate(randMove);
    }

    //计算场地边界对出界智能体的动量
    public void CheckEdge(){
      Curve[] differC = Curve.CreateBooleanDifference(shape, boundary, 0.000001);
      if(differC.Length != 0){
        Vector3d pushBack = new Vector3d();
        for (int i = 0; i < differC.Length; i++){
          overlapArea += AreaMassProperties.Compute(differC[i]).Area;
          Point3d subCenter = GetCenter(differC[i]);
          Vector3d push = Point3d.Subtract(siteCenter, subCenter);
          pushBack = Vector3d.Add(pushBack, push);
        }
        pushBack = Vector3d.Multiply(pushBack, 2.5 / pushBack.Length);
        move += pushBack;
      }
    }

    //判断该智能体是否与某智能体缓冲区内重叠，若有则两智能体都增加动量
    public void Seperate (Building b){
      double overlap = 0;
      Curve[] intersecs = Curve.CreateBooleanIntersection(shape, b.offShape, 0.000001);
      if(intersecs.Length != 0){
        for (int j = 0; j < intersecs.Length; j++){
          overlap += AreaMassProperties.Compute(intersecs[j]).Area;
          Point3d interCenter = GetCenter(intersecs[j]);
          Vector3d pi = Point3d.Subtract(pos, interCenter);
          Vector3d pj = Point3d.Subtract(GetCenter(b.offShape), interCenter);
          if(pi.Length == 0){
            pi = Point3d.Subtract(pos, b.pos);
            pj = Point3d.Subtract(b.pos, pos);
          }

          double dist = pos.DistanceTo(GetCenter(b.offShape));
          pi = Vector3d.Multiply(pi, 4 / dist);
          pj = Vector3d.Multiply(pj, 4 / dist);
          move = Vector3d.Add(move, Vector3d.Multiply(pi, 0.5));
          b.move = Vector3d.Add(b.move, Vector3d.Multiply(pj, 0.5));
        }
      }
    }

    //根据动量更新智能体位置
    public void Update (){
      pos = Point3d.Add(pos, move);
      shape.Translate(move);
      offShape.Translate(move);
      move = Vector3d.Multiply(move, 0);
    }

    //缩小
    public bool Narrow (double scale_factor){
      if(scale_dnum > 0)
      {
        shape.Transform(Transform.Scale(pos, scale_factor));
        offShape = CreateBuffer(shape, floor_height * floor_num);
        scale_dnum -= 1;
      }
      if(scale_dnum == 0)
      {
        alimit = true;
      }
      return(!alimit);
    }

    //计算各智能体不符合要求面积——>逾越场地边界的面积与其他智能体缓冲区内的重叠面积
    public void UpdateOverlap (List<Building> buildings){
      overlapArea = 0;
      for(int i = 0; i < buildings.Count; i++){
        Building b = buildings[i];
        Curve[] intersecs = Curve.CreateBooleanIntersection(shape, b.offShape, 0.000001);
        if(intersecs.Length != 0){
          for (int j = 0; j < intersecs.Length; j++){
            overlapArea += AreaMassProperties.Compute(intersecs[j]).Area;
          }
        }
      }
      Curve[] differC = Curve.CreateBooleanDifference(shape, boundary, 0.000001);
      if(differC.Length != 0){
        for (int i = 0; i < differC.Length; i++){
          overlapArea += AreaMassProperties.Compute(differC[i]).Area;
        }
      }
    }
  }


  //常用方法
  public class Common_void{
    public Common_void(){}

    //计算所有智能体不符合要求面积总和——>逾越场地边界的面积与其他智能体缓冲区内的重叠面积
    public double CheckOverlap_bs (List<Building> bs){
      double totalOverlap = 0;
      for(int i = 0; i < bs.Count; i++){
        for(int j = 0; j < bs.Count; j++){
          if(i != j)
          {
            Curve[] intersecs = Curve.CreateBooleanIntersection(bs[i].shape, bs[j].offShape, 0.000001);
            if(intersecs.Length != 0){
              for (int k = 0; k < intersecs.Length; k++){
                totalOverlap += AreaMassProperties.Compute(intersecs[k]).Area;
              }
            }
          }
        }
        Curve[] differC = Curve.CreateBooleanDifference(bs[i].shape, bs[i].boundary, 0.000001);
        if(differC.Length != 0){
          for (int j = 0; j < differC.Length; j++){
            totalOverlap += AreaMassProperties.Compute(differC[j]).Area;
          }
        }
      }
      return totalOverlap;
    }


    public int GetScaleANum(List<Building> bs)
    {
      int result = 0;
      for(int i = 0;i < bs.Count;i++)
      {
        if(bs[i].alimit == true)
        {
          result += 1;
        }
      }
      return result;
    }
    //Calculate total area of curves
    public double CalculateTotalArea(List<Curve> curve)
    {
      double result = 0;
      for(int i = 0; i < curve.Count; i++)
      {
        result += AreaMassProperties.Compute(curve[i]).Area;
      }
      return result;
    }

    public List<Point3d>GetRandomPoints(int i, Curve curve)
    {
      var func_info = Rhino.NodeInCode.Components.FindComponent("PopulateGeometry");
      var func = func_info.Delegate as dynamic;
      List<Curve> curves = new List<Curve>();
      curves.Add(curve);
      var result = func(Brep.CreatePlanarBreps(curves), i, 1, null);
      List<Point3d> points = new List<Point3d>();
      foreach (var temp in result)
      {
        points.Add((Point3d) temp);
      }
      return points;
    }
    public List<Curve>RepeatCurve(int i, Curve curve)
    {
      var func_info = Rhino.NodeInCode.Components.FindComponent("RepeatData");
      var func = func_info.Delegate as dynamic;
      var result = func(curve, i);

      List<Curve> curves = new List<Curve>();
      foreach (var temp in result)
      {
        curves.Add((Curve) temp);
      }
      return curves;
    }

  }
# ---------- end buildinggenerator00 ----------
buildinggenerator = CSharpScript(
    boundary=边界范围,
    shape_type=scale.Geometry,
    floor_height=楼高,
    density=建筑密度,
    plotRatio=容积率,
    floor=层数,
    threashold=容错阈值,
    scale_factor=缩放因子,
    area_limit=最小建筑面积,
    active=c_script)  # -> out, position, buildings, offShape, w; inputs boundary: Curve, shape_type: Curve, floor_height: Double, density: list of Double, plotRatio: list of Double, floor: list of Int32, threashold: Double, scale_factor: Double, area_limit: Double, active: String; disabled
# ---------- buildinggenerator: C# ----------
    //======初始化======
    com_void = new Common_void();
    string warning = "";

    double density_min = density_[0];
    double density_max = density_[1];
    double plotRatio_min = plotRatio_[0];
    double plotRatio_max = plotRatio_[1];
    int floor_num = floor_[0];
    int floor_min = floor_[1];
    int floor_max = floor_[2];
    //计算场地面积
    double boundaryArea = AreaMassProperties.Compute(boundary).Area;
    double shape_area = AreaMassProperties.Compute(shape_type).Area;

    //建筑密度计算智能体个数范围
    double area_scale = shape_area;
    double area_min = shape_area;
    int scale_dnum = 0;
    if(scale_factor != 1){
      while(area_scale >= area_limit){
        area_scale = area_scale * scale_factor * scale_factor;
        scale_dnum += 1;
      }
      area_min = area_scale * 1 / (scale_factor * scale_factor);
      scale_dnum -= 1;
    }

    int build_num_dmin = (int) Math.Ceiling(boundaryArea * density_min / shape_area);
    int build_num_dmax = (int) (boundaryArea * density_max / (area_min));
    //容积率计算智能体个数范围
    int build_num_pmin = (int) Math.Ceiling(plotRatio_min * boundaryArea / (shape_area * floor_max));
    int build_num_pmax = (int) (plotRatio_max * boundaryArea / (area_min * floor_min));
    //综合计算智能体个数范围
    int build_num_min,build_num_max = 0;
    if(build_num_dmin > build_num_pmin){
      build_num_min = build_num_dmin;}
    else{
      build_num_min = build_num_pmin;
    }
    if(build_num_dmax > build_num_pmax){
      build_num_max = build_num_pmax;}
    else{
      build_num_max = build_num_dmax;
    }
    //生成随机智能体个数
    Random rd = new Random();
    int build_num = rd.Next(build_num_min, build_num_max);
    List<double> tt = new List<double>();
    //tt.Add(shape_area);
    //tt.Add(area_min);
    //tt.Add(build_num);
    //生成相应个数的随机点与基于模板的建筑图形
    List<Point3d> randomPoints = com_void.GetRandomPoints(build_num, boundary);
    List< Curve> shape_types = new List<Curve>();
    shape_types = com_void.RepeatCurve(build_num, shape_type);
    //创建智能体
    bs = new List<Building>();
    for(int i = 0; i < build_num; i++){
      Building b = new Building(boundary, randomPoints[i], shape_types[i], floor_height, floor_num, scale_dnum);
      bs.Add(b);
    }

    double density = double.MinValue;
    double plotRatio = double.MinValue;
    bool ifChangeScale = true;
    bool ifLimitCount = false;
    double count = 0;
    double totalOverlap = double.MaxValue;
    double scale_anum = 0;
    List<int> seq = new List<int>();
    //======运行======
    //跳出循环条件
    //totalOverlap <= shape_area * threashold
    //density_min<=density <= density_max
    //plotRatio_min<=plotRatio <= plotRatio_max
    while(!(totalOverlap <= shape_area * threashold && density >= density_min && density <= density_max && plotRatio >= plotRatio_min && plotRatio <= plotRatio_max)){
      totalOverlap = 0;
      //迭代次数大于100时，迭代次数为智能体个数时对最不符合要求的建筑缩小
      if(ifChangeScale){
        if(count > 50 && count % bs.Count == 0){
          //索引
          seq.Clear();
          seq = new List<int>();
          for(int i = 0;i < bs.Count ;i++){
            //计算各智能体不符合要求的面积总和——>逾越场地边界的面积及其与其他智能体缓冲区内的总重叠面积
            bs[i].UpdateOverlap(bs);
            //获取缩小未完全达到限制的智能体索引
            if(bs[i].alimit != true){
              seq.Add(i);
            }
          }
          //获取总面积从大到小的相应索引
          int temp = 0;
          for(int i = 0;i < seq.Count - 1;i++){
            for(int j = 0;j < seq.Count - i - 1;j++){
              if(bs[seq[j]].overlapArea < bs[seq[j + 1]].overlapArea){
                temp = seq[j];
                seq[j] = seq[j + 1];
                seq[j + 1] = temp;
              }
            }
          }
          //缩小直至碰到一个可缩小的智能体，则退出循环
          for(int i = 0;i < seq.Count;i++){
            bool bool_atemp = bs[seq[i]].Narrow(scale_factor);
            if(bool_atemp)
              break;
          }
          //清空各智能体的存储数据——>不符合要求的面积总和
          for(int i = 0;i < bs.Count ;i++){
            bs[i].ClearOverlapArea();
          }
        }
      }

      for(int i = 0;i < bs.Count;i++){
        //计算场地边界对出界智能体的动量
        bs[i].CheckEdge();
        //根据该智能体与其他智能体的缓冲边界内的重叠情况，计算动量
        for(int j = 0; j < bs.Count; j++){
          if(i != j){
            bs[i].Seperate(bs[j]);
          }
        }
        //根据动量更新智能体位置
        bs[i].Update();
        //清空各智能体的存储数据——>不符合要求的面积总和
        bs[i].ClearOverlapArea();
      }
      if(scale_dnum > 0)
        scale_anum = com_void.GetScaleANum(bs);
      else
        scale_anum = 0;
      totalOverlap = com_void.CheckOverlap_bs(bs);
      count++;

      if(count == 100 && totalOverlap > shape_area * threashold && ifLimitCount){
        build_num = bs.Count - 1;
        bs.Clear();
        shape_types.Clear();
        randomPoints.Clear();
        randomPoints = com_void.GetRandomPoints(build_num, boundary);
        shape_types = com_void.RepeatCurve(build_num, shape_type);
        for(int i = 0; i < build_num; i++){
          Building b = new Building(boundary, randomPoints[i], shape_types[i], floor_height, floor_num, scale_dnum);
          bs.Add(b);
        }
        //直接进入下一次循环
        ifChangeScale = true;
        ifLimitCount = false;
        totalOverlap = double.MaxValue;
        scale_anum = 0;
        count = 0;
        continue;
      }
      //计算建筑密度与容积率
      double value_atemp = 0;
      double value_ftemp = 0;
      for(int i = 0;i < bs.Count;i++)
      {
        value_atemp += AreaMassProperties.Compute(bs[i].shape).Area;
        value_ftemp += bs[i].floor_num * AreaMassProperties.Compute(bs[i].shape).Area;
      }
      density = value_atemp / boundaryArea;
      plotRatio = value_ftemp / boundaryArea;

      //拟合失败，并所有已缩小至极致
      if(totalOverlap > shape_area * threashold && scale_anum == bs.Count && count % bs.Count == 0){
        build_num = bs.Count - 1;
      }
      //拟合成功,但建筑密度小于下限
      if(totalOverlap <= shape_area * threashold && density < density_min){
        build_num = bs.Count + 1;
      }
      //超出范围，退出循环
      if(build_num > build_num_max || build_num < build_num_min){
        warning = "拟合失败，原因可能是参数无法满足拟合，请适当放宽参数";
        break;
      }
        //在范围内，且智能体个数需要改变
      else if(build_num != bs.Count){
        bs.Clear();
        shape_types.Clear();
        randomPoints.Clear();
        randomPoints = com_void.GetRandomPoints(build_num, boundary);
        shape_types = com_void.RepeatCurve(build_num, shape_type);
        for(int i = 0; i < build_num; i++){
          Building b = new Building(boundary, randomPoints[i], shape_types[i], floor_height, floor_num, scale_dnum);
          bs.Add(b);
        }
        ifChangeScale = true;
        ifLimitCount = false;
        totalOverlap = double.MaxValue;
        scale_anum = 0;
        count = 0;
        continue;
      }
        //在范围内，且智能体个数不需要改变，则进行容积率的拟合
      else{
        if(totalOverlap <= shape_area * threashold){
          //容积率不在范围内
          if(plotRatio > plotRatio_max || plotRatio < plotRatio_max){
            seq.Clear();
            seq = new List<int>();
            for(int i = 0;i < bs.Count ;i++){
              seq.Add(i);
            }
            //获取从北到南的相应索引
            int temp = 0;
            for(int i = 0;i < seq.Count - 1;i++){
              for(int j = 0;j < seq.Count - i - 1;j++){
                if(bs[seq[j]].pos.Y < bs[seq[j + 1]].pos.Y){
                  temp = seq[j];
                  seq[j] = seq[j + 1];
                  seq[j + 1] = temp;
                }
              }
            }
            //容积率大于上限
            if(plotRatio > plotRatio_max){
              for(int i = floor_num;i > floor_min;i--){
                for(int j = 0;j < bs.Count;j++){
                  bs[seq[bs.Count - j - 1]].floor_num -= 1;
                  value_ftemp -= AreaMassProperties.Compute(bs[seq[bs.Count - j - 1]].shape).Area;
                  if (value_ftemp <= plotRatio_max * boundaryArea){
                    break;
                  }
                }
                if (value_ftemp <= plotRatio_max * boundaryArea){
                  break;
                }
              }
              //在范围内对楼层向下调整后，可使容积率拟合
              if(value_ftemp <= plotRatio_max * boundaryArea){
                ifChangeScale = false;
                ifLimitCount = false;
                totalOverlap = double.MaxValue;
                scale_anum = 0;
                count = 0;
                continue;
              }
                //楼层调至最低仍无法拟合容积率
              else{
                //减少智能体个数
                build_num = bs.Count - 1;
              }
            }
              //容积率小于下限
            else if(plotRatio < plotRatio_min){
              for(int i = floor_num;i < floor_max;i++){
                for(int j = 0;j < bs.Count;j++){
                  bs[seq[j]].floor_num += 1;
                  value_ftemp += AreaMassProperties.Compute(bs[seq[j]].shape).Area;
                  if (value_ftemp >= plotRatio_min * boundaryArea){
                    break;
                  }
                }
                if (value_ftemp >= plotRatio_min * boundaryArea){
                  break;
                }
              }
              //在范围内对楼层向上调整后，可使容积率拟合
              if(value_ftemp >= plotRatio_min * boundaryArea){
                ifChangeScale = false;
                ifLimitCount = true;
                totalOverlap = double.MaxValue;
                scale_anum = 0;
                count = 0;
                for(int i = 0;i < bs.Count;i++){
                  bs[i].offShape = bs[i].CreateBuffer(bs[i].shape, bs[i].floor_height * bs[i].floor_num);
                }
                continue;
              }
                //楼层调至最低仍无法拟合容积率
              else{
                //增加智能体个数
                build_num = bs.Count - 1;
              }
            }
              //容积率在范围内
            else{warning = "拟合成功";}
            //超出范围，退出循环
            if(build_num > build_num_max || build_num < build_num_min){
              warning = "拟合失败，原因可能是参数无法满足拟合，请适当放宽参数";
              break;
            }
              //在范围内，且智能体个数需要改变
            else if(build_num != bs.Count){
              bs.Clear();
              shape_types.Clear();
              randomPoints.Clear();
              randomPoints = com_void.GetRandomPoints(build_num, boundary);
              shape_types = com_void.RepeatCurve(build_num, shape_type);
              for(int i = 0; i < build_num; i++){
                Building b = new Building(boundary, randomPoints[i], shape_types[i], floor_height, floor_num, scale_dnum);
                bs.Add(b);
              }
              //直接进入下一次循环
              ifChangeScale = true;
              ifLimitCount = false;
              totalOverlap = double.MaxValue;
              scale_anum = 0;
              count = 0;
              continue;
            }
          }
        }
      }
    }

    //====输出=====
    pos_list = new List<Point3d>();
    footPrint = new List<Curve>();
    offSet = new List<Curve>();


    for(int i = 0; i < bs.Count; i++){
      pos_list.Add(bs[i].pos);
      footPrint.Add(bs[i].shape);
      offSet.Add(bs[i].offShape);
      tt.Add(AreaMassProperties.Compute(bs[i].shape).Area);
      tt.Add(bs[i].floor_num);
    }
    //tt.Add(com_void.CheckOverlap_bs(bs));
    //tt.Add(bs.Count);
    //tt.Add(build_num);
    //tt.Add(count);
    position = pos_list;
    buildings = footPrint;
    offShape = offSet;
    //w = tt;
    w = warning;
# ---------- buildinggenerator: C# additional code ----------
  //全局变量
  List<Building> bs;
  Common_void com_void;
  List<Point3d> pos_list;
  List<Curve> footPrint;
  List<Curve> offSet;


  //以下为构建建筑单体智能体代码
  public class Building{
    public Curve boundary;
    public Point3d pos;
    public Curve shape;
    public double floor_height;
    public int floor_num;
    public int scale_dnum;

    public Point3d siteCenter;
    public Curve offShape;
    public Vector3d move;

    public double overlapArea;
    public bool alimit;
    public Random rand;

    public Building(Curve boundary_, Point3d pos_, Curve shape_, double floor_height_, int floor_num_, int scale_dnum_){

      pos = new Point3d();
      floor_height = new double();
      floor_num = new int();
      scale_dnum = new int();
      boundary = boundary_;
      pos = pos_;
      shape = shape_;
      floor_height = floor_height_;
      floor_num = floor_num_;
      scale_dnum = scale_dnum_;

      siteCenter = GetCenter(boundary);
      Point3d center = AreaMassProperties.Compute(shape).Centroid;
      shape.Translate(new Vector3d(pos.X - center.X, pos.Y - center.Y, 0));
      offShape = CreateBuffer(shape, floor_height * floor_num);

      overlapArea = 0;
      if(scale_dnum > 0){
        alimit = false;
      }
      else{alimit = true;}
      rand = new Random();

    }

    //计算图形几何中心
    private Point3d GetCenter(Curve c){
      Point3d center = AreaMassProperties.Compute(c).Centroid;
      return center;
    }

    //清空各智能体的存储数据——>不符合要求的面积总和
    public void ClearOverlapArea(){
      overlapArea = 0;
    }

    //计算各智能体楼层数&&创建缓冲
    public void CalculateHeight(){
      offShape = CreateBuffer(shape, floor_height * floor_num);
    }
    //创建缓冲
    public Curve CreateBuffer(Curve x, double y)
    {

      List<Point3d> points_o = new List<Point3d>();
      List<Point3d> points_c = new List<Point3d>();
      int points_num = x.ToNurbsCurve().Points.Count;
      for (int i = 0;i < points_num;i++)
      {
        Point3d temp = new Point3d();
        x.ToNurbsCurve().Points.GetPoint(i, out temp);
        points_o.Add(temp);
        points_c.Add(temp);
      }
      //计算东南西北侧方向上的缓冲距离
      double distance_N,distance_E,distance_S,distance_W;
      if(0.3 * 30 + y - 30 * 0.1 < 6)
      {
        distance_E = distance_W = 6;
      }
      else
      {
        distance_E = distance_W = 0.3 * 30 + y - 30 * 0.1;
      }
      /*
      if(0.8 * 30 + y - 30 * 0.5 < 8)
      {
        distance_S = 8;
      }
      else
      {
        distance_S = 0.8 * 30 + y - 30 * 0.5;
      }
      */
      distance_S = 0;
      double sinHs = Math.Sin(Math.PI / 180 * 23) * Math.Sin(Math.PI / 180 * -23.5) + Math.Cos(Math.PI / 180 * 23) * Math.Cos(Math.PI / 180 * -23.5) * Math.Cos(0);
      double L = Math.Sqrt((y / sinHs) * (y / sinHs) - y * y);
      distance_N = L;
      //找出最北面的边的长度
      double distance_N_len = 0;
      for (int i = 0;i < points_num - 1;i++){
        //南北侧
        if(Math.Abs(points_o[i + 1].X - points_o[i].X) > Math.Abs(points_o[i + 1].Y - points_o[i].Y))
        {
          //北侧
          if((points_o[i + 1].X - points_o[i].X) > 0)
          {
            if(points_o[i + 1].X - points_o[i].X > distance_N_len){
              distance_N_len = points_o[i + 1].X - points_o[i].X;
            }
          }
        }
      }
      //图形均基于顺时针构建，因而可根据两点所形成的矢量方向，判断需要构建哪一方向的缓冲，最后用两点位置的移动进行缓冲的构建
      for (int i = 0;i < points_num - 1;i++){
        Point3d temp = new Point3d();
        //南北侧
        if(Math.Abs(points_o[i + 1].X - points_o[i].X) > Math.Abs(points_o[i + 1].Y - points_o[i].Y))
        {
          //北侧
          if((points_o[i + 1].X - points_o[i].X) > 0)
          {
            if(points_o[i + 1].X - points_o[i].X == distance_N_len){
              distance_N = L;
            }
            else{
              distance_N = 0;
            }
            temp = new Point3d(points_c[i].X, points_c[i].Y + distance_N, points_c[i].Z);
            points_c.RemoveAt(i);
            points_c.Insert(i, temp);
            temp = new Point3d(points_c[i + 1].X, points_c[i + 1].Y + distance_N, points_c[i + 1].Z);
            points_c.RemoveAt(i + 1);
            points_c.Insert(i + 1, temp);
          }
            //南侧
          else
          {
            temp = new Point3d(points_c[i].X, points_c[i].Y - distance_S, points_c[i].Z);
            points_c.RemoveAt(i);
            points_c.Insert(i, temp);
            temp = new Point3d(points_c[i + 1].X, points_c[i + 1].Y - distance_S, points_c[i + 1].Z);
            points_c.RemoveAt(i + 1);
            points_c.Insert(i + 1, temp);
          }
        }
          //东西侧
        else
        {
          if((points_o[i + 1].Y - points_o[i].Y) < 0)
          {
            //东侧
            temp = new Point3d(points_c[i].X + distance_E, points_c[i].Y, points_c[i].Z);
            points_c.RemoveAt(i);
            points_c.Insert(i, temp);
            temp = new Point3d(points_c[i + 1].X + distance_E, points_c[i + 1].Y, points_c[i + 1].Z);
            points_c.RemoveAt(i + 1);
            points_c.Insert(i + 1, temp);
          }
          else
          {
            //西侧
            temp = new Point3d(points_c[i].X - distance_W, points_c[i].Y, points_c[i].Z);
            points_c.RemoveAt(i);
            points_c.Insert(i, temp);
            temp = new Point3d(points_c[i + 1].X - distance_W, points_c[i + 1].Y, points_c[i + 1].Z);
            points_c.RemoveAt(i + 1);
            points_c.Insert(i + 1, temp);
          }
        }
      }
      //计算一个新的重合点，因为建筑轮廓上第一个点与最后一个点重合，构建缓冲后不重合
      double temp_x,temp_y;
      if(points_o[0].X == points_c[0].X)
      {
        temp_x = points_c[points_num - 1].X;
        temp_y = points_c[0].Y;
      }
      else
      {
        temp_x = points_c[0].X;
        temp_y = points_c[points_num - 1].Y;
      }
      Point3d point_orignal = new Point3d(temp_x, temp_y, points_c[0].Z);
      //重合点替换第一点
      points_c.RemoveAt(0);
      points_c.Insert(0, point_orignal);
      //重合点替换最后一点
      points_c.RemoveAt(points_num - 1);
      points_c.Insert(points_num - 1, point_orignal);
      Polyline buffer = new Polyline(points_c);
      return buffer.ToNurbsCurve();
    }

    //避免中心点重叠
    public void Overlap(List<Building> buildings){
      Vector3d randMove = new Vector3d(0, 0, 0);
      for(int i = 0; i < buildings.Count; i++){
        Building b = buildings[i];
        if(b != this && pos == b.pos){
          double randDir = Math.PI * rand.NextDouble();
          double bArea = AreaMassProperties.Compute(b.offShape).Area; //面积越大移动越远
          randMove = new Vector3d(Math.Cos(randDir) * bArea * 0.005, Math.Sin(randDir) * bArea * 0.005, 0);
          break;
        }
      }
      pos = Point3d.Add(pos, randMove);
      shape.Translate(randMove);
      offShape.Translate(randMove);
    }

    //计算场地边界对出界智能体的动量
    public void CheckEdge(){
      Curve[] differC = Curve.CreateBooleanDifference(shape, boundary, 0.000001);
      if(differC.Length != 0){
        Vector3d pushBack = new Vector3d();
        for (int i = 0; i < differC.Length; i++){
          overlapArea += AreaMassProperties.Compute(differC[i]).Area;
          Point3d subCenter = GetCenter(differC[i]);
          Vector3d push = Point3d.Subtract(siteCenter, subCenter);
          pushBack = Vector3d.Add(pushBack, push);
        }
        pushBack = Vector3d.Multiply(pushBack, 2.5 / pushBack.Length);
        move += pushBack;
      }
    }

    //判断该智能体是否与某智能体缓冲区内重叠，若有则两智能体都增加动量
    public void Seperate (Building b){
      double overlap = 0;
      Curve[] intersecs = Curve.CreateBooleanIntersection(shape, b.offShape, 0.000001);
      if(intersecs.Length != 0){
        for (int j = 0; j < intersecs.Length; j++){
          overlap += AreaMassProperties.Compute(intersecs[j]).Area;
          Point3d interCenter = GetCenter(intersecs[j]);
          Vector3d pi = Point3d.Subtract(pos, interCenter);
          Vector3d pj = Point3d.Subtract(GetCenter(b.offShape), interCenter);
          if(pi.Length == 0){
            pi = Point3d.Subtract(pos, b.pos);
            pj = Point3d.Subtract(b.pos, pos);
          }

          double dist = pos.DistanceTo(GetCenter(b.offShape));
          pi = Vector3d.Multiply(pi, 4 / dist);
          pj = Vector3d.Multiply(pj, 4 / dist);
          move = Vector3d.Add(move, Vector3d.Multiply(pi, 0.5));
          b.move = Vector3d.Add(b.move, Vector3d.Multiply(pj, 0.5));
        }
      }
    }

    //根据动量更新智能体位置
    public void Update (){
      pos = Point3d.Add(pos, move);
      shape.Translate(move);
      offShape.Translate(move);
      move = Vector3d.Multiply(move, 0);
    }

    //缩小
    public bool Narrow (double scale_factor){
      if(scale_dnum > 0)
      {
        shape.Transform(Transform.Scale(pos, scale_factor));
        offShape = CreateBuffer(shape, floor_height * floor_num);
        scale_dnum -= 1;
      }
      if(scale_dnum == 0)
      {
        alimit = true;
      }
      return(!alimit);
    }

    //计算各智能体不符合要求面积——>逾越场地边界的面积与其他智能体缓冲区内的重叠面积
    public void UpdateOverlap (List<Building> buildings){
      overlapArea = 0;
      for(int i = 0; i < buildings.Count; i++){
        Building b = buildings[i];
        Curve[] intersecs = Curve.CreateBooleanIntersection(shape, b.offShape, 0.000001);
        if(intersecs.Length != 0){
          for (int j = 0; j < intersecs.Length; j++){
            overlapArea += AreaMassProperties.Compute(intersecs[j]).Area;
          }
        }
      }
      Curve[] differC = Curve.CreateBooleanDifference(shape, boundary, 0.000001);
      if(differC.Length != 0){
        for (int i = 0; i < differC.Length; i++){
          overlapArea += AreaMassProperties.Compute(differC[i]).Area;
        }
      }
    }
  }


  //常用方法
  public class Common_void{
    public Common_void(){}

    //计算所有智能体不符合要求面积总和——>逾越场地边界的面积与其他智能体缓冲区内的重叠面积
    public double CheckOverlap_bs (List<Building> bs){
      double totalOverlap = 0;
      for(int i = 0; i < bs.Count; i++){
        for(int j = 0; j < bs.Count; j++){
          if(i != j)
          {
            Curve[] intersecs = Curve.CreateBooleanIntersection(bs[i].shape, bs[j].offShape, 0.000001);
            if(intersecs.Length != 0){
              for (int k = 0; k < intersecs.Length; k++){
                totalOverlap += AreaMassProperties.Compute(intersecs[k]).Area;
              }
            }
          }
        }
        Curve[] differC = Curve.CreateBooleanDifference(bs[i].shape, bs[i].boundary, 0.000001);
        if(differC.Length != 0){
          for (int j = 0; j < differC.Length; j++){
            totalOverlap += AreaMassProperties.Compute(differC[j]).Area;
          }
        }
      }
      return totalOverlap;
    }


    public int GetScaleANum(List<Building> bs)
    {
      int result = 0;
      for(int i = 0;i < bs.Count;i++)
      {
        if(bs[i].alimit == true)
        {
          result += 1;
        }
      }
      return result;
    }
    //Calculate total area of curves
    public double CalculateTotalArea(List<Curve> curve)
    {
      double result = 0;
      for(int i = 0; i < curve.Count; i++)
      {
        result += AreaMassProperties.Compute(curve[i]).Area;
      }
      return result;
    }

    public List<Point3d>GetRandomPoints(int i, Curve curve)
    {
      var func_info = Rhino.NodeInCode.Components.FindComponent("PopulateGeometry");
      var func = func_info.Delegate as dynamic;
      List<Curve> curves = new List<Curve>();
      curves.Add(curve);
      var result = func(Brep.CreatePlanarBreps(curves), i, 1, null);
      List<Point3d> points = new List<Point3d>();
      foreach (var temp in result)
      {
        points.Add((Point3d) temp);
      }
      return points;
    }
    public List<Curve>RepeatCurve(int i, Curve curve)
    {
      var func_info = Rhino.NodeInCode.Components.FindComponent("RepeatData");
      var func = func_info.Delegate as dynamic;
      var result = func(curve, i);

      List<Curve> curves = new List<Curve>();
      foreach (var temp in result)
      {
        curves.Add((Curve) temp);
      }
      return curves;
    }

  }
# ---------- end buildinggenerator ----------
drawbrep = CSharpScript(B=brep_2, C=ColourSwatch(SwatchColor=RGB(255, 64, 0)))  # -> out; inputs B: Brep, C: Color
# ---------- drawbrep: C# usings ----------
using System.IO;
using System.Linq;
using System.Data;
using System.Drawing;
using System.Reflection;
using System.Windows.Forms;
using System.Xml;
using System.Xml.Linq;
using System.Runtime.InteropServices;

using Rhino.DocObjects;
using Rhino.Collections;
using GH_IO;
using GH_IO.Serialization;
# ---------- drawbrep: C# ----------
    if (B == null) return;
    if (C.A == 0) return;

    _breps.Add(B);
    _materials.Add(new Rhino.Display.DisplayMaterial(C));
# ---------- drawbrep: C# additional code ----------
  private readonly List<Brep> _breps = new List<Brep>();
  private readonly List<Rhino.Display.DisplayMaterial> _materials = new List<Rhino.Display.DisplayMaterial>();
  private BoundingBox _box;

  /// <summary>
  /// This method will be called once every solution, before any calls to RunScript.
  /// </summary>
  public override void BeforeRunScript()
  {
    _box = BoundingBox.Empty;
    _breps.Clear();
    _materials.Clear();
  }

  public override BoundingBox ClippingBox
  {
    get { return _box; }
  }
  public override void DrawViewportMeshes(IGH_PreviewArgs args)
  {
    for (int i = 0; i < _breps.Count; i++)
      args.Display.DrawBrepWires(_breps[i], _materials[i].Diffuse, 0);
  }
  public override void DrawViewportWires(IGH_PreviewArgs args)
  {
    for (int i = 0; i < _breps.Count; i++)
      args.Display.DrawBrepShaded(_breps[i], _materials[i]);
  }
# ---------- end drawbrep ----------
drawbrep_2 = CSharpScript(B=brep_4, C=ColourSwatch(SwatchColor=RGB(255, 255, 107)))  # -> out; inputs B: Brep, C: Color; same code as drawbrep
drawbrep_3 = CSharpScript(B=brep_5, C=ColourSwatch(SwatchColor=RGB(255, 128, 191)))  # -> out; inputs B: Brep, C: Color; same code as drawbrep
drawbrep_4 = CSharpScript(B=brep_3, C=ColourSwatch(SwatchColor=RGB(255, 128, 255)))  # -> out; inputs B: Brep, C: Color; same code as drawbrep
drawbrep_5 = CSharpScript(B=brep, C=ColourSwatch(SwatchColor=RGB(0, 255, 128)))  # -> out; inputs B: Brep, C: Color; same code as drawbrep
panel_2 = Panel(buildinggenerator.w)
geo = Geometry(buildinggenerator.buildings)
geo_2 = Geometry(buildinggenerator.offShape)

# ----
# 数据导出
panel_3 = Panel("sample.3dm")
path = FilePath("F:\odrive\Google Drive\JH\Projects\[114] GrasshopperPlugins\Tutorials\Files\0015 Export Geometry with Grasshopper C#\")
c_script_2 = CSharpScript(filename=panel_3, directory=path, export=Toggle(False))  # inputs geometries: tree of GeometryBase, filename: String, directory: String, export: Boolean
# ---------- c_script_2: C# usings ----------
using System.IO;
# ---------- c_script_2: C# ----------
    if(export){

      var guids = new List<Guid>();

      for(int i = 0; i < geometries.BranchCount; i++){
        for(int n = 0; n < geometries.Branches[i].Count; n++){
          var geom = geometries.Branches[i][n];
          var guid = Rhino.RhinoDoc.ActiveDoc.Objects.Add(geom);
          guids.Add(guid);
        }
      }

      Rhino.RhinoDoc.ActiveDoc.Objects.Select(guids);

      string filepath = Path.Combine(directory, filename);
      string cmd = "_-Export " + "\"" + filepath + "\"" + " _Enter _Enter";

      Rhino.RhinoApp.RunScript(cmd, false);

      Rhino.RhinoDoc.ActiveDoc.Objects.Delete(guids, true);
    }
# ---------- end c_script_2 ----------

# ----
# 三维拉伸
vec = VectorXYZ(XComponent=0, YComponent=0, ZComponent=21)  # -> Vector, Length
extr = Extrude(Base=buildinggenerator.buildings, Direction=vec.Vector)
brep_6 = Brep(extr)
cap = CapHoles(Brep=brep_6)
drawbrep_6 = CSharpScript(B=cap, C=ColourSwatch(SwatchColor=RGB(128, 128, 128)))  # -> out; inputs B: Brep, C: Color; same code as drawbrep

panel_4 = Panel(buildinggenerator00.w)
geo_3 = Geometry(buildinggenerator00.offShape)
geo_4 = Geometry(buildinggenerator00.buildings)
边界范围_2 = Rectangle({Plane=PlaneXY(261.4704806, 144.7534212, 0), Size=Domain2(u=-253.2180219..253.2180219, v=-140.1885263..140.1885263)})

# ----
# 曲线渲染
toggle = BooleanToggle(True)  # disabled
crv_16 = Curve(buildinggenerator.offShape)
宽度 = Slider(3, range=0..20)
c_script_3 = CSharpScript(curve=crv_16, thickness=宽度, ifSolidLine=toggle, color=ColourSwatch(SwatchColor=RGB(140, 15, 83)))  # -> out, A; inputs curve: list of Curve, thickness: Int32, ifSolidLine: Boolean, color: Color
# ---------- c_script_3: C# usings ----------
using System.Drawing;
# ---------- c_script_3: C# ----------
    if (curve == null) return;
    if (color.A == 0) return;
    for (int i = 0; i < curve.Count; i++)
    {
      _curves.Add(curve[i]);
    }
    _color = color;
    _thickness = thickness;
# ---------- c_script_3: C# additional code ----------
  private BoundingBox _box;
  private readonly List<Curve> _curves = new List<Curve>();
  private readonly List<Rhino.Display.DisplayMaterial> _materials = new List<Rhino.Display.DisplayMaterial>();
  public Color _color;
  public int _thickness;
  //private BoundingBox _box;

  /// <summary>
  /// This method will be called once every solution, before any calls to RunScript.
  /// </summary>
  public override void BeforeRunScript()
  {
    _box = BoundingBox.Empty;
    _curves.Clear();
  }

  public override BoundingBox ClippingBox
  {
    get { return _box; }
  }

  public override void DrawViewportWires(IGH_PreviewArgs args)
  {
    for (int i = 0; i < _curves.Count; i++)
    {
      args.Display.DrawCurve(_curves[i], _color, _thickness);
    }
  }
# ---------- end c_script_3 ----------
